# Grasshopper definition BHoM Samples - CustomObjects - Grasshopper.gh (Grasshopper 0.9.76)
# plug-ins: BH.UI.Grasshopper

# ----
# Create Bar/BHoM Object
crv = Curve(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)
bar = Bar(
    Line=crv,
    OrientationAngle=0,
    FeaType="{ \"_t\" : \"System.Enum\", \"TypeName\" : { \"_t\" : \"System.Type\", \"Name\" : \"BH.oM.Structure.Elements.BarFEAType\" }, \"Value\" : \"Flexural\" }",
    Component="{ .Bar")
explode = Explode(Object=bar, Component="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")  # -> StartNode, EndNode, SectionProperty, OrientationAngle, Release, FEAType, Spring, Offset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

# ----
# Add Custom Properties
panel = Panel("GoodMorningUniverse")
pt = Point(Point(-69.59668872, 7.478620533, 0))
pt_2 = Point(Point(-65.00080158, 74.10804858, 0))
node = Node(Position=pt, Component="{ .Node")
node_2 = Node(Position=pt_2, Component="{ .Node")
createcustom = CreateCustom(Property1="HelloWorld", Property2=panel)
bar_2 = Bar(
    StartNode=node_2,
    EndNode=node,
    CustomProperty=createcustom,
    Component="{ \"_t\" : \"System.Type\", \"Name\" : \"BH.oM.Structure.Elements.Bar\" }")
explode_2 = Explode(Object=bar_2, Component="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")  # -> StartNode, EndNode, SectionProperty, OrientationAngle, Release, FEAType, Spring, Offset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
explode_3 = Explode(Object=explode_2.CustomData, Component="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")
explode_4 = Explode(Object=explode_3, Component="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")  # -> Property1, Property2
panel_2 = Panel([explode_4.Property1, explode_4.Property2])

# ----
# Convert Object to Text Format (Serialise)
tojson = ToJson(Obj=bar, Component="{ .ToJson")
tojson_2 = ToJson(Obj=bar_2, Component="{ .ToJson")
panel_3 = Panel(tojson)
panel_4 = Panel(tojson_2)

# ----
# Convert Object from Text (Deserialise)
fromjson = FromJson(Json=tojson, Component="{ .FromJson")
fromjson_2 = FromJson(Json=tojson_2, Component="{ .FromJson")
explode_5 = Explode(Object=fromjson_2, Component="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")  # -> StartNode, EndNode, SectionProperty, OrientationAngle, Release, FEAType, Spring, Offset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
explode_6 = Explode(Object=explode_5.CustomData, Component="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")
explode_7 = Explode(Object=explode_6, Component="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")  # -> Property1, Property2
panel_5 = Panel([explode_7.Property1, explode_7.Property2])
