# Grasshopper definition BHoM_Pull&Push Example.gh (Grasshopper 0.9.76)
# plug-ins: Alligator

# ----
# Pulling Revit Data Script
# Revit Adapter Script
boolean_toggle = BooleanToggle(False)
revitadapter = CreateAdapter(
    Boolean=boolean_toggle,
    MethodName=".ctor",
    NbParams=2,
    TypeName="BH.Adapter.Revit.RevitAdapter, Revit_Adapter, Version=1.0.0.0, Culture=neutral, PublicKeyToken=null",
    ParamType=["BH.oM.Revit.RevitSettings, Revit_oM, Version=1.0.0.0, Culture=neutral, PublicKeyToken=null", "System.Boolean, mscorlib, Version=4.0.0.0, Culture=neutral, PublicKeyToken=b77a5c561934e089"])
data_revit_adapter = Data(revitadapter)

# ----
# Revit Framing Element Pull Script
data_revit_adapter_2 = Data(data_revit_adapter)
create_bhom_type = CreateBHoMType(TypeName="BH.oM.Structural.Elements.FramingElement, BHoM, Version=1.0.0.0, Culture=neutral, PublicKeyToken=null")
filterquery = CreateQuery(
    ObjectType=create_bhom_type,
    MethodName="FilterQuery",
    NbParams=2,
    TypeName="BH.Engine.DataManipulation.Create, DataManipulation_Engine, Version=1.0.0.0, Culture=neutral, PublicKeyToken=null",
    ParamType=["System.Type, mscorlib, Version=4.0.0.0, Culture=neutral, PublicKeyToken=b77a5c561934e089", "System.String, mscorlib, Version=4.0.0.0, Culture=neutral, PublicKeyToken=b77a5c561934e089"])
pull = Pull(Adapter=data_revit_adapter_2, Query=filterquery, Active=Toggle(False))
bhom_object_revit_framing_elements = BHoMObject(pull)

# ----
# Revit Panel Pull Script
data_revit_adapter_3 = Data(data_revit_adapter)
create_bhom_type_2 = CreateBHoMType(TypeName="BH.oM.Structural.Elements.PanelPlanar, BHoM, Version=1.0.0.0, Culture=neutral, PublicKeyToken=null")
filterquery_2 = CreateQuery(
    ObjectType=create_bhom_type_2,
    MethodName="FilterQuery",
    NbParams=2,
    TypeName="BH.Engine.DataManipulation.Create, DataManipulation_Engine, Version=1.0.0.0, Culture=neutral, PublicKeyToken=null",
    ParamType=["System.Type, mscorlib, Version=4.0.0.0, Culture=neutral, PublicKeyToken=b77a5c561934e089", "System.String, mscorlib, Version=4.0.0.0, Culture=neutral, PublicKeyToken=b77a5c561934e089"])
pull_2 = Pull(Adapter=data_revit_adapter_3, Query=filterquery_2, Active=Toggle(False))
bhom_object_revit_panels = BHoMObject(pull_2)

# ----
# Internalise Data & Preview
bhom_object_revit_framing_elements_2 = BHoMObject(bhom_object_revit_framing_elements)
bhom_object_revit_panels_2 = BHoMObject(bhom_object_revit_panels)
alledgecurves = QueryBHoMObject(
    BHoMObject=bhom_object_revit_panels_2,
    MethodName="AllEdgeCurves",
    NbParams=1,
    TypeName="BH.Engine.Structure.Query, Structure_Engine, Version=1.0.0.0, Culture=neutral, PublicKeyToken=null",
    ParamType="BH.oM.Structural.Elements.PanelPlanar, BHoM, Version=1.0.0.0, Culture=neutral, PublicKeyToken=null")
analyticalbars = QueryBHoMObject(
    BHoMObject=bhom_object_revit_framing_elements_2,
    MethodName="AnalyticalBars",
    NbParams=1,
    TypeName="BH.Engine.Structure.Query, Structure_Engine, Version=1.0.0.0, Culture=neutral, PublicKeyToken=null",
    ParamType="BH.oM.Structural.Elements.FramingElement, BHoM, Version=1.0.0.0, Culture=neutral, PublicKeyToken=null")
boundary_surfaces = BoundarySurfaces(Edges=alledgecurves)

# ----
# BHoM - Slab & Wall Split
bhom_object_revit_panels_3 = BHoMObject(bhom_object_revit_panels_2)
alledgecurves_2 = QueryBHoMObject(
    BHoMObject=bhom_object_revit_panels_3,
    MethodName="AllEdgeCurves",
    NbParams=1,
    TypeName="BH.Engine.Structure.Query, Structure_Engine, Version=1.0.0.0, Culture=neutral, PublicKeyToken=null",
    ParamType="BH.oM.Structural.Elements.PanelPlanar, BHoM, Version=1.0.0.0, Culture=neutral, PublicKeyToken=null")
control_points = ControlPoints(Curve=alledgecurves_2)  # -> Points, Weights, Knots
trim_tree = TrimTree(Tree=control_points.Points, Depth=1)
fitplane = ComputeAnalyse(
    BHoMGeometry=trim_tree,
    Tolerance=1e-06,
    MethodName="FitPlane",
    NbParams=2,
    TypeName="BH.Engine.Geometry.Compute, Geometry_Engine, Version=1.0.0.0, Culture=neutral, PublicKeyToken=null",
    ParamType=["System.Collections.Generic.List`1[[BH.oM.Geometry.Point, BHoM, Version=1.0.0.0, Culture=neutral, PublicKeyToken=null]], mscorlib, Version=4.0.0.0, Culture=neutral, PublicKeyToken=b77a5c561934e089", "System.Double, mscorlib, Version=4.0.0.0, Culture=neutral, PublicKeyToken=b77a5c561934e089"])  # -> flatten(BHoMGeometry)
deconstruct_plane = DeconstructPlane(Plane=fitplane)  # -> Origin, XAxis, YAxis, ZAxis
deconstruct = Deconstruct(Point=deconstruct_plane.ZAxis)  # -> XComponent, YComponent, ZComponent
absolute = Absolute(Value=deconstruct.ZComponent)
smaller_than = SmallerThan(FirstNumber=absolute, SecondNumber="1e-5")  # -> SmallerThan, OrEqualTo
bhom_panels = BHoMObject(bhom_object_revit_panels_3)
bhom_panels_2 = BHoMObject(bhom_object_revit_panels_3)
boolean = Boolean(invert(smaller_than.SmallerThan))
boolean_2 = Boolean(smaller_than.SmallerThan)
cull_pattern = CullPattern(List=bhom_panels, CullPattern=boolean)
cull_pattern_2 = CullPattern(List=bhom_panels_2, CullPattern=boolean_2)
clean_tree = CleanTree(RemoveNulls=True, RemoveInvalid=True, RemoveEmpty=False, Tree=cull_pattern)
clean_tree_2 = CleanTree(RemoveNulls=True, RemoveInvalid=True, RemoveEmpty=False, Tree=cull_pattern_2)
bhom_walls = BHoMObject(clean_tree_2)
bhom_slabs = BHoMObject(clean_tree)

# ----
# Convert from BHoM Framing Elements to BHoM Bars Script
bhom_object_revit_framing_elements_3 = BHoMObject(bhom_object_revit_framing_elements_2)
analyticalbars_2 = QueryBHoMObject(
    BHoMObject=bhom_object_revit_framing_elements_3,
    MethodName="AnalyticalBars",
    NbParams=1,
    TypeName="BH.Engine.Structure.Query, Structure_Engine, Version=1.0.0.0, Culture=neutral, PublicKeyToken=null",
    ParamType="BH.oM.Structural.Elements.FramingElement, BHoM, Version=1.0.0.0, Culture=neutral, PublicKeyToken=null")  # -> flatten(B)
bhom_object_bar_elements = BHoMObject(analyticalbars_2)

# ----
# Collecting Member Components
bhom_object_bar_elements_2 = BHoMObject(bhom_object_bar_elements)
bhom_slabs_2 = BHoMObject(clean_tree)
bhom_walls_2 = BHoMObject(clean_tree_2)

# ----
# Adding Supports to Base Nodes Script
# Extracting Bar Nodes Script
bhom_object_bar_elements_3 = BHoMObject(bhom_object_bar_elements)
panel = Panel("""StartNode
EndNode""")
get_property = GetProperty(Object=graft(bhom_object_bar_elements_3), Key=panel)  # -> flatten(PropertyValue)
bhom_object_bar_nodes = BHoMObject(get_property)

# ----
# Extracting Wall Nodes Script
panel_2 = Panel("ExternalEdges")
bhom_walls_3 = BHoMObject(clean_tree_2)
get_property_2 = GetProperty(Object=bhom_walls_3, Key=panel_2)
get_property_3 = GetProperty(Object=get_property_2, Key="Curve")
explode = Explode(Curve=get_property_3, Recursive=True)  # -> Segments, Vertices
data_wall_nodes = Data(explode.Vertices)

# ----
# Editting Slab Properties Script
# Revit slabs are 250mm THK C30/37 concrete
# Edit to 300mm THK C40/50 concrete
concrete = Concrete(
    {"C12/15": JustDoIt, "C16/20": JustDoIt, "C20/25": JustDoIt, "C25/30": JustDoIt, "C30/37": JustDoIt, "C35/45": JustDoIt, "C40/50": JustDoIt, "C45/55": JustDoIt, "C50/60": JustDoIt, "C55/67": JustDoIt, "C60/75": JustDoIt, "C70/85": JustDoIt, "C80/95": JustDoIt, "C90/105": JustDoIt}, selected="C40/50",
    FileName="Materials\MaterialsEurope\Concrete")
bhom_slabs_3 = BHoMObject(bhom_slabs)
constantthickness = CreateBHoMObject(
    Thickness="0.3",
    BHoMObject=concrete,
    Text="300mm THK R.C. Slab",
    Enum=null,
    MethodName="ConstantThickness",
    NbParams=4,
    TypeName="BH.Engine.Structure.Create, Structure_Engine, Version=1.0.0.0, Culture=neutral, PublicKeyToken=null",
    ParamType=["System.Double, mscorlib, Version=4.0.0.0, Culture=neutral, PublicKeyToken=b77a5c561934e089", "BH.oM.Common.Materials.Material, BHoM, Version=1.0.0.0, Culture=neutral, PublicKeyToken=null", "System.String, mscorlib, Version=4.0.0.0, Culture=neutral, PublicKeyToken=b77a5c561934e089", "BH.oM.Structural.Properties.PanelType, BHoM, Version=1.0.0.0, Culture=neutral, PublicKeyToken=null"])
set_property = SetProperty(BHoMObject=bhom_slabs_3, Key="Property", Value=constantthickness)
editted_bhom_slabs = BHoMObject(set_property)

# ----
# Extracting Base Nodes Script
bhom_object_bar_nodes_2 = BHoMObject(bhom_object_bar_nodes)
get_property_4 = GetProperty(Object=bhom_object_bar_nodes_2, Key="Position")
deconstruct_2 = Deconstruct(Point=get_property_4)  # -> XComponent, YComponent, ZComponent
smaller_than_2 = SmallerThan(FirstNumber=deconstruct_2.ZComponent, SecondNumber="1e-6")  # -> SmallerThan, OrEqualTo
bhom_object_bar_nodes_3 = BHoMObject(bhom_object_bar_nodes)
cull_pattern_3 = CullPattern(List=bhom_object_bar_nodes_3, CullPattern=smaller_than_2.SmallerThan)
bhom_object_support_nodes = BHoMObject(cull_pattern_3)

# ----
# Preview Slab Property Updates Script
editted_bhom_object = BHoMObject(editted_bhom_slabs)
explode_2 = Explode(Object=editted_bhom_object)  # -> ExternalEdges, Openings, Property, BHoM_Guid, Name, Tags, CustomData
explode_3 = Explode(Object=explode_2.Property)  # -> Thickness, Material, PanelType, BHoM_Guid, Name, Tags, CustomData
panel_3 = Panel(explode_3.Thickness)
panel_4 = Panel(explode_3.Name)
explode_4 = Explode(Object=explode_3.Material)  # -> Type, YoungsModulus, PoissonsRatio, DryDensity, CoeffThermalExpansion, DampingRatio, Density, CompressiveYieldStrength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
panel_5 = Panel(explode_4.Name)

# ----
# Extracting Wall Base Nodes Script
data_wall_nodes_2 = Data(data_wall_nodes)
deconstruct_3 = Deconstruct(Point=data_wall_nodes_2)  # -> XComponent, YComponent, ZComponent
smaller_than_3 = SmallerThan(FirstNumber=deconstruct_3.ZComponent, SecondNumber="1e-6")  # -> SmallerThan, OrEqualTo
cull_pattern_4 = CullPattern(List=data_wall_nodes_2, CullPattern=smaller_than_3.SmallerThan)  # -> flatten(List)
data_wall_support_nodes = Data(cull_pattern_4)

# ----
# Setting Bar Support Property Script
boolean_toggle_2 = BooleanToggle(True)
boolean_toggle_3 = BooleanToggle(False)
bhom_object_support_nodes_2 = BHoMObject(bhom_object_support_nodes)
constraint6dof = CreateBHoMObject(
    x=boolean_toggle_2,
    y=boolean_toggle_2,
    z=boolean_toggle_2,
    xx=boolean_toggle_3,
    yy=boolean_toggle_3,
    zz=boolean_toggle_3,
    name="Pinned",
    MethodName="Constraint6DOF",
    NbParams=7,
    TypeName="BH.Engine.Structure.Create, Structure_Engine, Version=1.0.0.0, Culture=neutral, PublicKeyToken=null",
    ParamType=["System.Boolean, mscorlib, Version=4.0.0.0, Culture=neutral, PublicKeyToken=b77a5c561934e089", "System.Boolean, mscorlib, Version=4.0.0.0, Culture=neutral, PublicKeyToken=b77a5c561934e089", "System.Boolean, mscorlib, Version=4.0.0.0, Culture=neutral, PublicKeyToken=b77a5c561934e089", "System.Boolean, mscorlib, Version=4.0.0.0, Culture=neutral, PublicKeyToken=b77a5c561934e089", "System.Boolean, mscorlib, Version=4.0.0.0, Culture=neutral, PublicKeyToken=b77a5c561934e089", "System.Boolean, mscorlib, Version=4.0.0.0, Culture=neutral, PublicKeyToken=b77a5c561934e089", "System.String, mscorlib, Version=4.0.0.0, Culture=neutral, PublicKeyToken=b77a5c561934e089"])
set_property_2 = SetProperty(BHoMObject=bhom_object_support_nodes_2, Key="Constraint", Value=constraint6dof)
bhom_object_bar_support_nodes = BHoMObject(set_property_2)

# ----
# Creating Wall Nodes with Support Property Script
boolean_toggle_4 = BooleanToggle(True)
boolean_toggle_5 = BooleanToggle(True)
data_wall_support_nodes_2 = Data(data_wall_support_nodes)
constraint6dof_2 = CreateBHoMObject(
    x=boolean_toggle_4,
    y=boolean_toggle_4,
    z=boolean_toggle_4,
    xx=boolean_toggle_5,
    yy=boolean_toggle_5,
    zz=boolean_toggle_5,
    name="Fixed",
    MethodName="Constraint6DOF",
    NbParams=7,
    TypeName="BH.Engine.Structure.Create, Structure_Engine, Version=1.0.0.0, Culture=neutral, PublicKeyToken=null",
    ParamType=["System.Boolean, mscorlib, Version=4.0.0.0, Culture=neutral, PublicKeyToken=b77a5c561934e089", "System.Boolean, mscorlib, Version=4.0.0.0, Culture=neutral, PublicKeyToken=b77a5c561934e089", "System.Boolean, mscorlib, Version=4.0.0.0, Culture=neutral, PublicKeyToken=b77a5c561934e089", "System.Boolean, mscorlib, Version=4.0.0.0, Culture=neutral, PublicKeyToken=b77a5c561934e089", "System.Boolean, mscorlib, Version=4.0.0.0, Culture=neutral, PublicKeyToken=b77a5c561934e089", "System.Boolean, mscorlib, Version=4.0.0.0, Culture=neutral, PublicKeyToken=b77a5c561934e089", "System.String, mscorlib, Version=4.0.0.0, Culture=neutral, PublicKeyToken=b77a5c561934e089"])
node = CreateBHoMObject(
    BHoMGeometry=data_wall_support_nodes_2,
    BHoMObject=constraint6dof_2,
    MethodName="Node",
    NbParams=3,
    TypeName="BH.Engine.Structure.Create, Structure_Engine, Version=1.0.0.0, Culture=neutral, PublicKeyToken=null",
    ParamType=["BH.oM.Geometry.Point, BHoM, Version=1.0.0.0, Culture=neutral, PublicKeyToken=null", "System.String, mscorlib, Version=4.0.0.0, Culture=neutral, PublicKeyToken=b77a5c561934e089", "BH.oM.Structural.Properties.Constraint6DOF, BHoM, Version=1.0.0.0, Culture=neutral, PublicKeyToken=null"])
bhom_object_wall_support_nodes = BHoMObject(node)

# ----
# Combine Support Nodes Script
bhom_object_wall_support_nodes_2 = BHoMObject(bhom_object_wall_support_nodes)
bhom_object_bar_support_nodes_2 = BHoMObject(bhom_object_bar_support_nodes)
bhom_object_support_nodes_3 = BHoMObject([bhom_object_bar_support_nodes_2, bhom_object_wall_support_nodes_2])

# ----
# Combing All BHoM Data Script
bhom_object_bar_elements_4 = BHoMObject(flatten(bhom_object_bar_elements))
bhom_object_support_nodes_4 = BHoMObject(bhom_object_support_nodes_3)
editted_bhom_slabs_2 = BHoMObject(editted_bhom_slabs)
bhom_walls_4 = BHoMObject(bhom_walls)
bhom_object_combined = BHoMObject(flatten([bhom_object_support_nodes_4, bhom_object_bar_elements_4, bhom_walls_4, editted_bhom_slabs_2]))

# ----
# Robot Adapter Script
boolean_toggle_6 = BooleanToggle(False)
robotadapter = CreateAdapter(
    Boolean=boolean_toggle_6,
    MethodName=".ctor",
    NbParams=3,
    TypeName="BH.Adapter.Robot.RobotAdapter, Robot_Adapter, Version=1.0.0.0, Culture=neutral, PublicKeyToken=null",
    ParamType=["System.String, mscorlib, Version=4.0.0.0, Culture=neutral, PublicKeyToken=b77a5c561934e089", "BH.oM.Adapters.Robot.RobotConfig, Robot_oM, Version=1.0.0.0, Culture=neutral, PublicKeyToken=null", "System.Boolean, mscorlib, Version=4.0.0.0, Culture=neutral, PublicKeyToken=b77a5c561934e089"])
data_robot_adapter = Data(robotadapter)

bhom_object_combined_2 = BHoMObject(bhom_object_combined)

# ----
# Pushing Data to Robot Script
# Pushing Object to Robot Script
data_robot_adapter_2 = Data(data_robot_adapter)
push = Push(Adapter=data_robot_adapter_2, Objects=bhom_object_combined_2, Active=Toggle(False))  # -> Success, Objects
